# Grasshopper definition API.PVGIS.Examples.gh (Grasshopper 1.0.7)
# plug-ins: ZymeToolbox.Grasshopper

latitude = Panel("44.746733")
longitude = Panel("5.092163")

# ----
# MONTHLY RAD
toggle = BooleanToggle(True)
pvgis_monthly_radiation = PVGISMonthlyRadiation(Latitude=latitude, Longitude=longitude, StartYear="2018", EndYear="2020", UseHorizon=True, POAInclination=0, Run=toggle)  # -> UrlQuery, Json_meta, Json_inputs, Latitude, Longitude, Elevation, Year, Month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

# ----
# TMY
toggle_2 = BooleanToggle(True)
path = FilePath("C:\Users\lionel\Desktop\DownloadEPW\")
pvgis_tmy = PVGISTypicalMeteorologicalYear(Latitude=latitude, Longitude=longitude, StartYear="2010", UseHorizon=True, FilePath=path, Run=toggle_2)  # -> UrlQuery, Json_meta, Json_inputs, Latitude, Longitude, Elevation, TimeUTC, GlobalIrradiance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

# ----
# HOURLY RAD
toggle_3 = BooleanToggle(True)
pvgis_hourly_radiation = PVGISHourlyRadiation(
    Latitude=latitude,
    Longitude=longitude,
    StartYear="2018",
    EndYear="2020",
    UseHorizon=True,
    POATracking=0,
    POAInclination=0,
    POAAzimuth=0,
    POAOptimizeInclination=False,
    POAOptimizeInclinationAndAzimiuth=False,
    PVMountingType=0,
    PVTechnology=0,
    PVPeakPower=1,
    PVLoss=14,
    Run=toggle_3)  # -> UrlQuery, Json_meta, Json_inputs, Latitude, Longitude, Elevation, Time, PVPower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

# ----
# DAILY RAD
toggle_4 = BooleanToggle(True)
pvgis_daily_radiation = PVGISDailyRadiation(
    Latitude=latitude,
    Longitude=longitude,
    Month=0,
    UseHorizon=True,
    POAInclination=35,
    POAAzimuth=0,
    TimeUnit=False,
    Run=toggle_4)  # -> UrlQuery, Json_meta, Json_inputs, Latitude, Longitude, Elevation, Month, Time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

# ----
# PV Performance : Off-Grid
toggle_5 = BooleanToggle(True)
pvgis_perf_off_grid_pv = PVGISPerformanceOfOffGridPVSystem(
    Latitude=latitude,
    Longitude=longitude,
    UseHorizon=True,
    PVPeakPower=1000,
    PVBatteryCapacity=400,
    PVBatteryCutoff=40,
    PVDailyConsumption=300,
    POAInclination="30",
    POAAzimuth=0,
    Run=toggle_5)  # -> urlQuery, json_meta, json_inputs, latitude, longitude, elevation, month, E_daily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

# ----
# PV Performance : Grid-Connected
toggle_6 = BooleanToggle(True)
pvgis_perf_on_grid_pv = PVGISPerformanceOfGridConnectedPVSystem(
    Latitude=latitude,
    Longitude=longitude,
    UseHorizon=True,
    PVTechnology=0,
    PVPeakPower=1,
    PVLoss=14,
    PVMountingType=0,
    POAInclination=0,
    POAAzimuth=0,
    POAOptimizeInclination=False,
    POAOptimizeInclinationAndAzimiuth=False,
    AnnualInterestRateIn=10,
    ExpectedLifetime=30,
    Run=toggle_6)  # -> UrlQuery, Json_meta, Json_inputs, Latitude, Longitude, Elevation, PerformanceResults

# ----
# PV Performance : Tracking
toggle_7 = BooleanToggle(True)
pvgis_perf_tracking_pv = PVGISPerformanceOfTrackingPVSystem(
    Latitude=latitude,
    Longitude=longitude,
    UseHorizon=True,
    PVTechnology=0,
    PVPeakPower=1,
    PVLoss=14,
    VerticalAxisAngle=30,
    OptimizeVerticalAxisAngle=False,
    InclinedAxisAngle=90,
    OptimizeInclinedAxisAngle=False,
    Run=toggle_7)  # -> UrlQuery, Json_meta, Json_inputs, Latitude, Longitude, Elevation, PerformanceResults

list = ValueList({"Grid-Connected": 0, "Tracking": 1}, selected="Grid-Connected")

# ----
# Example Graph With Ladybug
number_slider = Slider(1, range=1..12)
c_script = CSharpScript(
    months=pvgis_daily_radiation.Month,
    times=pvgis_daily_radiation.Time,
    values=pvgis_daily_radiation.GlobalClearSkyIrradianceForPOA,
    mi=number_slider)  # -> out, COUNT, SUM, AVG; inputs months: list of Int32, times: list of String, values: list of Double, mi: Int32
# ---------- c_script: C# usings ----------
using System.Linq;
# ---------- c_script: C# ----------
    int[][] count = new int[12][];
    double[][] sum = new double[12][];
    double[][] avg = new double[12][];

    for (int i = 0; i < 12; i++)
    {
      count[i] = new int[24];
      sum[i] = new double[24];
      avg[i] = new double[24];
    }

    for (int i = 0; i < months.Count; i++)
    {
      var m = months[i];
      var h = Convert.ToInt32(times[i].Substring(0, 2));
      sum[m - 1][h] = values[i];
      count[m - 1][h] += 1;
    }

    for (int i = 0; i < sum.Length; i++)
    {
      for (int j = 0; j < sum[i].Length; j++)
      {
        avg[i][j] = sum[i][j] / count[i][j];
      }

    }

    SUM = sum[mi - 1];
    AVG = avg[mi - 1];
    COUNT = count[mi - 1];
# ---------- end c_script ----------
c_script_2 = CSharpScript(
    months=pvgis_daily_radiation.Month,
    times=pvgis_daily_radiation.Time,
    values=pvgis_daily_radiation.GlobalIrradianceForPOA,
    mi=number_slider)  # -> out, COUNT, SUM, AVG; inputs months: list of Int32, times: list of String, values: list of Double, mi: Int32; same code as c_script
c_script_3 = CSharpScript(
    months=pvgis_daily_radiation.Month,
    times=pvgis_daily_radiation.Time,
    values=pvgis_daily_radiation.DirectIrradianceForPOA,
    mi=number_slider)  # -> out, COUNT, SUM, AVG; inputs months: list of Int32, times: list of String, values: list of Double, mi: Int32; same code as c_script
c_script_4 = CSharpScript(
    months=pvgis_daily_radiation.Month,
    times=pvgis_daily_radiation.Time,
    values=pvgis_daily_radiation.DiffuseIrradianceForPOA,
    mi=number_slider)  # -> out, COUNT, SUM, AVG; inputs months: list of Int32, times: list of String, values: list of Double, mi: Int32; same code as c_script
analysisperiod = LBAnalysisPeriod(start_month=number_slider, start_day=1, start_hour=0, end_month=number_slider, end_day=1)  # -> period, hoys, dates; plug-in component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
constrheader = LBConstructHeader(data_type="EnergyFlux", unit="W/m2", a_period=analysisperiod.period)  # -> header; plug-in component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
data = LBConstructData(header=constrheader, values=c_script.AVG, interval="hourly")  # -> data; plug-in component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
legendpar = LBLegendParameters(max=1200, seg_count=7)  # -> leg_par; plug-in component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
data_2 = LBConstructData(header=constrheader, values=c_script_3.AVG, interval="hourly")  # -> data; plug-in component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
data_3 = LBConstructData(header=constrheader, values=c_script_4.AVG, interval="hourly")  # -> data; plug-in component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
data_4 = LBConstructData(header=constrheader, values=c_script_2.AVG, interval="hourly")  # -> data; plug-in component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
monthlychart = LBMonthlyChart(data=[data, data_4, data_2, data_3], x_dim=50, legend_par=legendpar)  # -> report, data_mesh, data_lines, col_lines, legend, borders, labels, y_title, title, vis_set; plug-in component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

filter = StreamFilter(Gate=list, Stream0=pvgis_perf_on_grid_pv.PerformanceResults, Stream1=pvgis_perf_tracking_pv.PerformanceResults)

# ----
# PV Performance : Browse Results
pvgis_perf_total_results = PVGISGetPVPerformanceTotalResults(Performance=filter)  # -> Label, AverageDailyEnergyProduction, AverageMonthlyEnergyProduction, AverageYearlyEnergyProduction, AverageDailySumOfGlobalIrradiance, AverageMonthlySumOfGlobalIrradiance, AverageYearlySumOfGlobalIrradiance, DeviationOfMonthlyEnergyProduction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
pvgis_perf_monthly_results = PVGISGetPVPerformanceMonthlyResults(Performance=simplify(filter))  # -> Label, Month, simplify(AverageDailyEnergyProduction), simplify(AverageMonthlyEnergyProduction), simplify(AverageDailySumOfGlobalIrradiance), simplify(AverageMonthlySumOfGlobalIrradiance), simplify(DeviationOfMonthlyEnergyProduction)
panel = Panel(pvgis_perf_monthly_results.Label)

units = LBUnitConverter()  # -> all_u, values; plug-in component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
panel_2 = Panel(units.all_u)
visset = LBPreviewVisualizationSet(vis_set=monthlychart.vis_set)  # -> vs; plug-in component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
