# Grasshopper definition IO.Examples.gh (Grasshopper 1.0.7)
# plug-ins: ZymeToolbox.Grasshopper

doe_weather_data_index = DOEWeatherDataIndex(
    urls="https://raw.githubusercontent.com/NREL/EnergyPlus/develop/weather/master.geojson",
    filterPtLatitude=0,
    filterPtLongitude=0,
    filterRadius=0)  # -> WeatherDataTitle, WMOStationID, StationName, WMORegionID, CountryCode, ZoneCode, DataSource, Latitude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
subset = SubList(List=doe_weather_data_index.EPWURL, Domain=Domain(1, 20), Wrap=True)  # -> List, Index
button = Button()
# https://energyplus-weather.s3.amazonaws.com/europe_wmo_region_6/FRA/FRA_Lyon.074810_IWEC/FRA_Lyon.074810_IWEC.zip
toggle = BooleanToggle(True)
panel = Panel(subset.List)
path = FilePath("C:\Users\lionel\Desktop\DownloadEPW\")
# https://energyplus-weather.s3.amazonaws.com/europe_wmo_region_6/FRA/FRA_Lyon.074810_IWEC/FRA_Lyon.074810_IWEC.epw
path_2 = FilePath(["C:\Users\lionel\Desktop\DownloadEPW\EGY_Al.Minya.623870_ETMY.epw", "C:\Users\lionel\Desktop\DownloadEPW\EGY_Alexandria.623180_ETMY.epw", "C:\Users\lionel\Desktop\DownloadEPW\EGY_Aswan.624140_ETMY.epw", "C:\Users\lionel\Desktop\DownloadEPW\EGY_Aswan.624140_IWEC.epw", "C:\Users\lionel\Desktop\DownloadEPW\EGY_Asyut.623930_ETMY.epw", "C:\Users\lionel\Desktop\DownloadEPW\EGY_Cairo.623660_IWEC.epw", "C:\Users\lionel\Desktop\DownloadEPW\EGY_Cairo.Intl.Airport.623660_ETMY.epw", "C:\Users\lionel\Desktop\DownloadEPW\EGY_El.Arish.623370_ETMY.epw", "C:\Users\lionel\Desktop\DownloadEPW\EGY_Helwan.623780_ETMY.epw", "C:\Users\lionel\Desktop\DownloadEPW\EGY_Hurghada.624630_ETMY.epw", "C:\Users\lionel\Desktop\DownloadEPW\EGY_Ismailia.624400_ETMY.epw", "C:\Users\lionel\Desktop\DownloadEPW\EGY_Kharga.624350_ETMY.epw", "C:\Users\lionel\Desktop\DownloadEPW\EGY_Luxor.624050_ETMY.epw", "C:\Users\lionel\Desktop\DownloadEPW\ETH_Addis.Ababa-Bole.634500_SWERA.epw", "C:\Users\lionel\Desktop\DownloadEPW\ETH_Awassa.634600_SWERA.epw", "C:\Users\lionel\Desktop\DownloadEPW\ETH_Bahar.Dar.633320_SWERA.epw", "C:\Users\lionel\Desktop\DownloadEPW\ETH_Combolcha.633330_SWERA.epw", "C:\Users\lionel\Desktop\DownloadEPW\ETH_Debre.Marcos.633340_SWERA.epw", "C:\Users\lionel\Desktop\DownloadEPW\ETH_Dire.Dawa.634710_SWERA.epw", "C:\Users\lionel\Desktop\DownloadEPW\ETH_Gondar.633310_SWERA.epw"])
download = DowlnoadFile(UrlToFile=panel, DirectoryPath=path, Overwrite=toggle, ExtractZIP=toggle, Run=Toggle(False))
url = EPWLocationFromUrl(UrlOfEPWFile=path_2, Run=Toggle(True))
panel_2 = Panel(download)
